# Dynamo graph ChristmasScript.dyn "ChristmasScriptX" (Dynamo 2.16.2.5624)
# packages: spring nodes 204.1.0, archi-lab.net 2023.213.1722

# group: Package used
# note: spring nodes | v.210.1.1
# archilab |

# group: Suggestions ^^
code_block = CodeBlock { "FSPXRXFFSXPRXF"; }
code_block_2 = CodeBlock { "FLSRSXRXPFXPLX"; }

# group: UI #1 - Enter your name
python_script = Python()  # IronPython2; unwired: IN[0]
# ---------- python_script.python (72 lines) ----------
import clr
clr.AddReference("System.Windows.Forms")
clr.AddReference("System.Drawing")
import System
from System.Windows.Forms import *
from System.Drawing import *
from System.Net import WebClient
from System.IO import MemoryStream

Runme = True

class CreateWindow(Form):
    def __init__(self):
        self.Name = "Create Window"
        self.Text = "♪♫ Please enter your name and turn up your volume ♫"
        self.Size = Size(600, 300)
        self.CenterToScreen()
        self.value = None
        
        # Load the image from the URL
        image_url = "https://github.com/MoosiestMoose/Christmas23/raw/main/0.25%20size.jpg"
        image = Image.FromStream(System.Net.WebRequest.Create(image_url).GetResponse().GetResponseStream())

        # Set the background image of the form
        self.BackgroundImage = image
        self.BackgroundImageLayout = ImageLayout.Stretch

        # Create controls
        label = Label(Text="Please enter your name")
        label.Parent = self
        label.Location = Point(203, 105)
        label.Height = 15
        label.Width = 168
        label.Font = Font("Arial", 11)
        label.ForeColor = Color.White
        label.BackColor = Color.Red

        self.textbox = TextBox()
        self.textbox.Parent = self
        self.textbox.Text = "Moose moose"
        self.textbox.Location = Point(203, 125)
        self.textbox.Size = Size(169, 30)
        self.textbox.Font = Font("Arial", 14)
        self.textbox.Multiline = True
        self.textbox.CharacterCasing = CharacterCasing.Upper
        
        self.button1 = Button()
        self.button1.Parent = self
        self.button1.Text = "Next step!"
        self.button1.Font = Font("Arial", 14)
        self.button1.Location = Point(203, 165)
        self.button1.Width = 169
        self.button1.Height = 40
        self.button1.Click += self.ButtonClicked
        self.button1.BackColor = Color.Green
        self.button1.ForeColor = Color.White

        # Make the form always on top
        self.TopMost = True

    def ButtonClicked(self, sender, args):
        if sender == self.button1:  # make tree
            self.value = self.textbox.Text, True
            self.Close()
        else:
            self.value = None, False
            self.Close()

# Call the form
form = CreateWindow()
Application.Run(form)
OUT = form.value
# ----------------------------------------
code_block_3 = CodeBlock(name=python_script)
# ---------- code_block_3.designscript (2 lines) ----------
"Thank you for running this Dynamo script " + name[0]
+ "I hope you have a happy Christmas and fantastic new year, best wishes from Manchester, England.";
# ----------------------------------------
python_script_2 = Python(IN[0]=code_block_3)  # IronPython2
# ---------- python_script_2.python (11 lines) ----------
import clr
clr.AddReference('System.Speech')
import System.Speech as sp
import System.Speech.Synthesis as sy

se = sy.SpeechSynthesizer()
#se.SelectVoiceByHints(sy.VoiceGender.Female, sy.VoiceAge.Adult)
se.Rate = 1
se.SpeakAsync(IN[0])

OUT = True
# ----------------------------------------

# group: UI #2 - L-system
# note: Warning: The higher this number is the longer it takes. High numbers could take hours.
# 3-6 is usually OK :)
total_iterations_not_inc_start = IntegerSlider(4, range=1..8 step 1)  # graph input
python_script_3 = Python(IN[0]=python_script)  # IronPython2
# ---------- python_script_3.python (148 lines) ----------
import clr
clr.AddReference("System.Windows.Forms")
clr.AddReference("System.Drawing")
import System
from System.Windows.Forms import *
from System.Drawing import *
from System.Diagnostics import Process

Runme = IN[0][1]

class CreateWindow(Form):
    def __init__(self):
        self.Name = "Create Window"
        self.Text = "♪♫ Oh Christmas Tree 2023! ♫"
        self.Size = Size(1200, 810)
        self.CenterToScreen()
        self.value = None
        
        # Load the image from the URL
        image_url = "https://github.com/MoosiestMoose/Christmas23/raw/main/0.25%20size.jpg"
        image = Image.FromStream(System.Net.WebRequest.Create(image_url).GetResponse().GetResponseStream())

        # Set the background image of the form
        self.BackgroundImage = image
        self.BackgroundImageLayout = ImageLayout.None

        # Create controls
        label = Label(Text="Welcome to the Dynamo tree maker!")
        label.Parent = self
        label.Location = Point(400, 265)
        label.Height = 30
        label.Width = 450
        label.Font = Font("Arial", 18, FontStyle.Bold)
        label.ForeColor = Color.White
        label.BackColor = Color.Transparent

        label = Label(Text="Enter between 12 and 20 letters \n(a combination of: F X S P L R)")
        label.Parent = self
        label.Location = Point(475, 345)
        label.Height = 35
        label.Width = 400
        label.Font = Font("Arial", 12)
        label.ForeColor = Color.White
        label.BackColor = Color.Transparent

        self.textbox = TextBox()
        self.textbox.Parent = self
        self.textbox.Text = "FLSRSXRXPFXPLX"
        self.textbox.Location = Point(450, 300)
        self.textbox.Size = Size(330, 40)
        self.textbox.Font = Font("Arial", 18)
        self.textbox.Multiline = True
        self.textbox.CharacterCasing = CharacterCasing.Upper

        label = Label(Text="⛄ Instructions ⛄\n1: Use a blank Revit file and open a 3D window\n2: Use only these letters: F X S P L R\n3: For every S there must be a P \n4: There must always be an S before a P \n(other letters can be inbetween each pair)\nExample: FSPXRXFFSXPRXF ")
        label.Parent = self
        label.Location = Point(50, 630)
        label.Height = 125
        label.Width = 345
        label.Font = Font("Arial", 11)
        label.ForeColor = Color.Crimson
        
        label = Label(Text="❄What do the letters mean? ❄\n F = Draw line\n X = Repeat pattern\n S = Save location + angle\n P = Return to previous position + angle\n L = Turn left 25 degrees\n R = Turn right 25 degrees")
        label.Parent = self
        label.Location = Point(450, 630)
        label.Height = 125
        label.Width = 300
        label.Font = Font("Arial", 11)
        label.ForeColor = Color.Green
        label.BackColor = Color.Transparent      
      
        label = Label(Text="♡ Extra information ♡")
        label.Parent = self
        label.Location = Point(840, 630)
        label.Height = 15
        label.Width = 300
        label.Font = Font("Arial", 11)
        label.ForeColor = Color.Crimson
        
        # Create a LinkLabel control
        self.linkLabel2 = LinkLabel()
        self.linkLabel2.Text = "These trees are L-systems (click for info)"
        self.linkLabel2.AutoSize = True
        self.linkLabel2.Location = Point(840, 648)
        self.linkLabel2.Font = Font("Arial", 11, FontStyle.Regular)
        self.linkLabel2.LinkClicked += self.linkLabel2_LinkClicked			

        label = Label(Text="Some trees grow faster than others\nBe patient while your tree grows\nLines and objects will be created in Revit\nDelete your old tree before making a new one\nCode by LP + background image by MM")
        label.Parent = self
        label.Location = Point(840, 669)
        label.Height = 90
        label.Width = 320
        label.Font = Font("Arial", 11)
        label.ForeColor = Color.Crimson

        # Add the LinkLabel control to the form
        self.Controls.Add(self.linkLabel2)        
        self.button1 = Button()
        self.button1.Parent = self
        self.button1.Text = "Make a tree"
        self.button1.Font = Font("Arial", 14)
        self.button1.Location = Point(530, 450)
        self.button1.Width = 150
        self.button1.Height = 50
        self.button1.Click += self.ButtonClicked
        self.button1.BackColor = Color.Green
        self.button1.ForeColor = Color.White

        # Make the form always on top
        self.TopMost = True

    def ButtonClicked(self, sender, args):
        #if sender == self.button2:  # 
            #self.value = "RESET"
            #self.Close()
        if sender == self.button1:  # make tree
            self.value = self.textbox.Text
            self.Close()
            
    def linkLabel2_LinkClicked(self, sender, e):
        filePath = r"https://en.wikipedia.org/wiki/L-system"
        process = Process()
        process.StartInfo.FileName = filePath
        process.Start()

allowed_letters = set('FXSPLR')

# Call the form
while Runme:
    # Call the form
    form = CreateWindow()
    Application.Run(form)
    if form.value == "RESET":
        OUT = form.value
        break
    if not form.value.isalpha():
        continue
    if not set(form.value).issubset(allowed_letters):
        continue
    # Check if the form value has an equal number of 'S' and 'P'
    if form.value.count('S') != form.value.count('P'):
        continue
    if len(form.value) > 20:
        continue
    if len(form.value) < 12:
        continue
    OUT = form.value
    break
# ----------------------------------------
# note: variables = "XF"
# constants = "LRSP" # L = turn left R = turn right S = save P = pop
# axiom = "X"
# rules = {
#     "X": "FLSRRSXPRXPRFRSLLRFXPLX",
#     "F": "FF",
# }
# note: F = draw line
# X = do nothing
# S = Save position + save angle
# P = Pop position + pop angle
# L = Turn left 25 degrees
# R = Turn right 25 degrees
python_script_4 = Python(IN[0]=total_iterations_not_inc_start, IN[1]=python_script_3)  # IronPython2
# ---------- python_script_4.python (35 lines) ----------
def apply_rules(input_string, rules):
    result = []
    for symbol in input_string:
        if symbol in rules:
            result.append(rules[symbol])
        else:
            result.append(symbol)
    return ''.join(result)

def generate_l_system(axiom, rules, iterations):
    current_string = axiom
    l_system = []
    for i in range(iterations):
        current_string = apply_rules(current_string, rules)
        l_system.append(current_string)
    return l_system

iterations = IN[0]
code = IN[1]
variables = "XF"
constants = "LRSP" # L = turn left R = turn right S = save P = pop
axiom = "X"
rules = {
    "X": code,
    "F": "FF",
}

l_system = generate_l_system(axiom, rules, iterations)

# Access the L-system strings for each iteration using l_system list
output_strings = []
for i, iteration_string in enumerate(l_system):
    output_strings.append(iteration_string)

OUT = iteration_string
# ----------------------------------------
python_script_5 = Python(IN[0]=python_script_4)  # IronPython2
# ---------- python_script_5.python (36 lines) ----------
## fractal plant
import sys
import clr
clr.AddReference('ProtoGeometry')
from Autodesk.DesignScript.Geometry import *
import math

rows = IN[0]
Lines = []
StartPoint = Point.ByCoordinates(0, 0, 0)
vector = Vector.ByCoordinates(0, 0 , 1)
SavedPositions = []
SavedAngles = []
for row in rows:
	for letter in row:
		if letter == "F": 
			Line = Line.ByStartPointDirectionLength(StartPoint, vector, 200)
			Lines.append(Line)				
			StartPoint = Line.EndPoint	
		elif letter == "X": 
			continue	
		elif letter == "L":	#Rotate 25 degrees left	
			vector = vector.Rotate(Vector.YAxis(),-25)
		elif letter == "R":	#Rotate 25 degrees right	
			vector = vector.Rotate(Vector.YAxis(), 25)
		elif letter == "S":
			SavedPositions.append(StartPoint)
			SavedAngles.append(vector)
		elif letter == "P":
			StartPoint = SavedPositions[-1]
			vector = SavedAngles[-1]
			SavedPositions.pop()
			SavedAngles.pop()


OUT = Lines
# ----------------------------------------

# group: Pot
origin = Point.Origin()
code_block_4 = CodeBlock { Point.ByCoordinates(0, 0, 500); 200; 300; }
byPointsRadii = Cone.ByPointsRadii(startPoint=origin, endPoint=code_block_4.out0, startRadius=code_block_4.out1, endRadius=code_block_4.out2)

# group: UI
rotations = IntegerSlider(7, range=3..15 step 2)  # graph input

# group: Rotate
code_block_5 = CodeBlock(origin=origin) { origin; }
ZAxis = Vector.ZAxis()
code_block_6 = CodeBlock(n=rotations) { 0..360- (360/n)..#n; }
rotate = Geometry.Rotate(geometry=python_script_5, origin=code_block_5, axis=ZAxis, degrees=code_block_6, lacing=CrossProduct)
flatten = List.Flatten(list=rotate)

# group: Nodules :)
startPoint = Curve.StartPoint(curve=flatten)
endPoint = Curve.EndPoint(curve=flatten)
zipped = Python(IN[0]=startPoint, IN[1]=endPoint)  # IronPython2
# ---------- zipped.python (5 lines) ----------
def toList(lst):
	if hasattr(lst,"__iter__"): return lst
	else: return [lst]

OUT = zip(toList(IN[0]),toList(IN[1]))
# ----------------------------------------
flatten_2 = List.Flatten(list=zipped)
code_block_7 = CodeBlock { 15; }
byCenterPointRadius = Circle.ByCenterPointRadius(centerPoint=flatten_2, radius=code_block_7)

# group: Get random endpoints
python_script_6 = Python(IN[0]=flatten_2)  # IronPython2
# ---------- python_script_6.python (16 lines) ----------
# Assuming you have a list of points called 'allPoints'
allPoints = IN[0]

# Count occurrences of each point in the list
pointCounts = {}
for point in allPoints:
    if point in pointCounts:
        pointCounts[point] += 1
    else:
        pointCounts[point] = 1

# Filter points that appear only once
uniquePoints = [point for point, count in pointCounts.items() if count == 1]

# Output the points that appear only once
OUT = uniquePoints
# ----------------------------------------
python_script_7 = Python(IN[0]=python_script_6)  # IronPython2
# ---------- python_script_7.python (12 lines) ----------
import random
import math

allItems = IN[0]
n = math.floor(len(allItems) / 40)

# Shuffle the list and select the first 'n' items
random.shuffle(allItems)
selectedItems = allItems[:int(n)]

# Output the selected items
OUT = selectedItems
# ----------------------------------------
code_block_8 = CodeBlock { -200; }
translate = Geometry.Translate(geometry=python_script_7, zTranslation=code_block_8)

# group: Create baubles in Revit
code_block_9 = CodeBlock { 100; }
byCenterPointRadius_2 = Sphere.ByCenterPointRadius(centerPoint=translate, radius=code_block_9)
# note: Path for family template
# depending on your Revit version
python_script_8 = Python()  # IronPython2; graph input
# ---------- python_script_8.python (12 lines) ----------
import clr
clr.AddReference("RevitServices")
from RevitServices.Persistence import DocumentManager

# Get the current Revit document
doc = DocumentManager.Instance.CurrentDBDocument

# Get the Revit version
revitVersion = doc.Application.VersionNumber

# Output the Revit version
OUT = "C:\ProgramData\Autodesk\RVT " + str(revitVersion) + "\Family Templates\English\Metric Generic Model.rft"
# ----------------------------------------
# note: Super lazy creating a family per bauble
# instead of copying...
python_script_9 = Python(IN[0]=byCenterPointRadius_2)  # IronPython2
# ---------- python_script_9.python (10 lines) ----------
geo = IN[0]

names = [] 
count = 1

for i in geo:
	names.append("bauble " + str(count))
	count += 1
	
OUT = names
# ----------------------------------------
code_block_10 = CodeBlock { "Generic Models"; }
byName = Category.ByName(name=code_block_10)
# note: Custom Node: spring nodesv.210.1.1
ꟿ_familyinstance_bygeometry = Custom[ꟿ FamilyInstance.ByGeometry](geometry=byCenterPointRadius_2, familyTemplatePath=python_script_8, familyName=python_script_9, category=byName)  # package spring nodes; You must provide a valid family template path that will be used for all input geometry objects. The project units(and not the templates) will be used to determine the size of the output geometry. The provided category will be used only if the family template supports it. If not, the default template category will be used instead. Likewise, the family material(provided as a string) will be set only if a material with that name exists in the template. If not, the default material will be used instead ("By Category"). For void cuts, the material settings will be ignored. The Subcategory name is an optional input. If you'd like to skip assigning a Subcategory to any new instance, simply use null. The node expects a unique family name for each geometry object. The rest of the input lists will be processed as if the node lacing is set to longest.
code_block_11 = CodeBlock { DSCore.Color.ByARGB(0,255,0,0); }
overrideColorInView = Element.OverrideColorInView(element=ꟿ_familyinstance_bygeometry.instance, color=code_block_11)

# group: Create a filter mask for the trunk
direction = Line.Direction(line=flatten)
normalized = Vector.Normalized(vector=direction)
ZAxis_2 = Vector.ZAxis()
isAlmostEqualTo = Vector.IsAlmostEqualTo(vector=normalized, otherVector=ZAxis_2)

filterByBoolMask = List.FilterByBoolMask(list=flatten, mask=isAlmostEqualTo@L2)

# group: Create lines in Revit
code_block_12 = CodeBlock(a=filterByBoolMask.out, b=byCenterPointRadius) { [a , b]; }
byCurve = ModelCurve.ByCurve(curve=code_block_12)
byCurve_2 = ModelCurve.ByCurve(curve=filterByBoolMask.in)

# group: Tree overrides
code_block_13 = CodeBlock { DSCore.Color.ByARGB(0,0,128,64); }
code_block_14 = CodeBlock { 6; }
byProperties = Revit.Filter.OverrideGraphicSettings.ByProperties(projectionLineColor=code_block_13, projectionLineWeight=code_block_14)
overrideInView = Element.OverrideInView(element=byCurve, overrides=byProperties)

# group: Pot in Revit
categories = Categories("OST_Casework")
code_block_15 = CodeBlock { "Tree tub"; }
byGeometry = DirectShape.ByGeometry(geometry=byPointsRadii, category=categories, name=code_block_15)

# group: Twinkle twinkle
origin_2 = Point.Origin()
Z = Point.Z(point=flatten_2)
# note: Highest Z point
maximumItem = List.MaximumItem(list=Z)
translate_2 = Geometry.Translate(geometry=origin_2, zTranslation=maximumItem)
# note: Create star with lines
python_script_10 = Python(IN[0]=translate_2)  # IronPython2
# ---------- python_script_10.python (40 lines) ----------
import clr
clr.AddReference('ProtoGeometry')
from Autodesk.DesignScript.Geometry import *
import math

# Dynamo inputs
radius_outer = 500
radius_inner = 200
center = IN[0]

# Dynamo output
lines_star = []
lines_y_low = []
lines_y_high = []

# Create a 5-pointed star shape in the XZ plane
points = []
for i in range(5):
    angle = i * (2 * math.pi / 5)
    point = Point.ByCoordinates(center.X + radius_outer * math.cos(angle), center.Y, center.Z + radius_outer * math.sin(angle))
    points.append(point)

# Connect points in pairs, closing the loop
for i in range(len(points)):
    lines_star.append(Line.ByStartPointEndPoint(points[i], points[(i + 2) % 5]))

# Calculate points on the y-axis perpendicular to the lines
y_point_low = center.Translate(Vector.ByCoordinates(0, -radius_inner / 2, 0))
y_point_high = center.Translate(Vector.ByCoordinates(0, radius_inner / 2, 0))

# Connect each star point to the low Y point
for point in points:
    lines_y_low.append(Line.ByStartPointEndPoint(point, y_point_low))

# Connect each star point to the high Y point
for point in points:
    lines_y_high.append(Line.ByStartPointEndPoint(point, y_point_high))

# Output lines
OUT = lines_star, lines_y_low, lines_y_high
# ----------------------------------------
byCurve_3 = ModelCurve.ByCurve(curve=python_script_10)

# group: Star overrides
code_block_16 = CodeBlock { DSCore.Color.ByARGB(0,255,255,0); }
code_block_17 = CodeBlock { 10; }
byProperties_2 = Revit.Filter.OverrideGraphicSettings.ByProperties(projectionLineColor=code_block_16, projectionLineWeight=code_block_17)
overrideInView_2 = Element.OverrideInView(element=byCurve_3, overrides=byProperties_2)

# group: Trunk overrides
code_block_18 = CodeBlock { DSCore.Color.ByARGB(0,120,84,28); }
code_block_19 = CodeBlock { 12; }
byProperties_3 = Revit.Filter.OverrideGraphicSettings.ByProperties(projectionLineColor=code_block_18, projectionLineWeight=code_block_19)
overrideInView_3 = Element.OverrideInView(element=byCurve_2, overrides=byProperties_3)

# group: Show fat lines
code_block_20 = CodeBlock { false; }
# note: Custom Node: archilab
showThinLines = archilab.Revit.Elements.ThinLinesOptions.ShowThinLines(show=code_block_20)

# group: Set Revit display style
current = Document.Current()
activeView = Document.ActiveView(document=current)
python_script_11 = Python(IN[0]=activeView)  # IronPython2
# ---------- python_script_11.python (17 lines) ----------
import clr
clr.AddReference('RevitAPI')
from Autodesk.Revit.DB import*

clr.AddReference('RevitServices')
import RevitServices
from RevitServices.Persistence import DocumentManager
from RevitServices.Transactions import TransactionManager

doc = DocumentManager.Instance.CurrentDBDocument
TransactionManager.Instance.EnsureInTransaction(doc)

view = UnwrapElement(IN[0])
list = []
view.get_Parameter(BuiltInParameter.MODEL_GRAPHICS_STYLE).Set(4)
	
TransactionManager.Instance.TransactionTaskDone()
# ----------------------------------------
